# Grasshopper definition 3dcp_Base_GH_Template.gh (Grasshopper 1.0.7)
# plug-ins: KUKA|prc - parametric robot control, DendroGH

# ----
# 1. SETUP
# Environment
world_collision = Mesh(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)
# 工作區域
shelf_collision = Mesh(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)
mjoin = MeshJoin(Meshes=[world_collision, shelf_collision])
world_visual = Mesh([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])
collision = Mesh(mjoin)

# ----
# Tool
探針 = Slider(40, range=0..100)
addition = Addition(A=探針, B="-730.795")
frame = FrameKUKAPrc(FrameNumber=0, XValue=addition, YValue="-3.746", ZValue="163.803", AValue="0", BValue="180", CValue="90", toolaxis="X")  # -> KUKAPrcFrame, XYZABCAsPlane
mesh = Mesh(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)
custom_tool_pln = CustomToolPlaneKUKAPrc(ToolGeometry=mesh, ToolNumber="9", ToolPlane=frame.XYZABCAsPlane, frameinput=False)

number_slider = Slider(0, range=-300..300)
selected_plane = ValueList({"PlaneO": 0, "PlaneA": 1, "PlaneB": 2}, selected="PlaneO")
# Robot Workspace
selected_plane_2 = ValueList({"PlaneO": 0, "PlaneA": 1, "PlaneB": 2}, selected="PlaneA")
correction = Slider(10, range=0..50)

# ----
# Safe Working Area
panel = Panel("-1100")
frame_2 = FrameKUKAPrc(FrameNumber=0, XValue=panel, YValue="140", ZValue="-480", AValue=0, BValue=0, CValue=0, toolaxis="Z")  # -> KUKAPrcFrame, XYZABCAsPlane
box = DomainBox(Base=frame_2.XYZABCAsPlane, X="3000", Y="2000", Z="6000")

io = IO()  # -> _0, _1, _2, _3

# ----
# Raccoon KUKA Robot Cell Template
# Concrete Printing
# Robot
cluster = Cluster()  # -> robot, robot_2

cluster_2 = Cluster_2(data=selected_plane_2, O=correction, X=number_slider)  # -> G, srf_2, C, s_1
cluster_3 = Cluster_3(data=selected_plane, O=correction, X=number_slider)  # -> G, srf_2, C, s_0
# SETUP
digout03_on = Data(io._3)
digout02_on = Data(io._2)
pt = Point(Tree({0}: [Point(275.3446665, 7.475506529, 880), Point(283.3007378, 19.19858034, 880), Point(244.4031929, 17.09032763, 880), Point(278.3564702, 36.68822806, 880), Point(266.655583, 40.8048497, 880), Point(272.6015073, 53.91859575, 880)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], {1}: [Point(284.0442393, 8.869566178, 890), Point(244.8507529, 8.550368467, 890), Point(280.6474445, 28.41486668, 890), Point(282.5502956, 39.40282787, 890), Point(275.2792177, 45.80137096, 890), Point(263.4368336, 49.73725763, 890)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], {2}: [Point(272.3730758, 8.281871473, 900), Point(281.818842, 18.20722997, 900), Point(285.1509363, 29.59463725, 900), Point(277.9341169, 37.66001985, 900), Point(266.1924766, 41.93395083, 900), Point(266.8130174, 52.20579457, 900)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]))
pt_2 = Point(Tree({0}: [Point(280.6740012, 8.590878038, 910), Point(244.8507529, 8.550368467, 910), Point(279.5201126, 27.58727616, 910), Point(282.5725053, 39.04817178, 910), Point(275.1423094, 47.00459832, 910), Point(266.789459, 52.9659078, 910)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], {1}: [Point(269.1569785, 8.580340221, 920), Point(278.8047123, 18.06881105, 920), Point(244.4031929, 17.09032763, 920), Point(277.1442616, 37.07331039, 920), Point(265.6689882, 43.89077886, 920), Point(266.8609872, 53.83005415, 920)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], {2}: [Point(277.8205799, 8.997039133, 930), Point(267.4681808, 17.9632024, 930), Point(276.8569421, 27.66214231, 930), Point(243.6578644, 25.60947301, 930), Point(268.7704482, 45.62707073, 930), Point(263.0009997, 53.27896605, 930)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], {3}: [Point(270.6708192, 9.178303904, 940), Point(270.3039641, 18.4463223, 940), Point(269.692037, 27.69357913, 940), Point(268.8369824, 36.90979481, 940), Point(242.6156769, 34.09740906, 940), Point(266.2300023, 55.19829058, 940)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], {4}: [Point(269.8320905, 0.2282333982, 950), Point(269.7013364, 9.549382923, 950), Point(269.3216692, 18.85949595, 950), Point(268.6943551, 28.14788278, 950), Point(267.8213971, 37.40398928, 950), Point(241.2779, 42.54380035, 950)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], {5}: [Point(269.0566605, 0.6093982622, 960), Point(268.9141553, 9.977570944, 960), Point(268.519942, 19.33395002, 960), Point(267.8753051, 28.66752928, 960), Point(266.9824183, 37.96748123, 960), Point(265.8442027, 47.22319178, 960)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]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))
bbox = BoundingBox(Content=flatten(pt), Plane=PlaneXY(0, 0, 0), UnionBox=True)  # -> Box, Box_2
group = Group(Objects=pt_2)
group_2 = Group(Objects=pt)
box_2 = EvaluateBox(Box=bbox.Box, UParameter="0.5", VParameter="0.5", WParameter="0")  # -> Plane, Point, Include
# 2. OPERATIONS
number_slider_2 = Slider(0.5, range=0..1)
plane = Plane(cluster_2.G)
xy = XYPlane(Origin=box_2.Plane)
orient = Orient(Geometry=group, Source=xy, Target=plane)  # -> Geometry, Transform
orient_2 = Orient(Geometry=group_2, Source=xy, Target=plane)  # -> Geometry, Transform
vsettings = CreateSettings(VoxelSize=1, Bandwidth=Slider(0.5, range=0..1), Isovalue=number_slider_2, Adaptivity=0.1)
ungroup = Ungroup(Group=orient_2.Geometry)  # -> flatten(Objects)
nurbs = NurbsCurve(Vertices=ungroup, Degree=3, Periodic=False)  # -> flatten(Curve), Length, Domain
vcurve = CurveToVolume(Curves=nurbs.Curve, CurveRadius="12.5", Settings=vsettings)
ungroup_2 = Ungroup(Group=orient.Geometry)
panel_2 = Panel(orient.Geometry)
vsmooth = SmoothVolume(Volume=vcurve, Width=1, Type=2, Iterations=1)
xy_2 = XYPlane(Origin=ungroup_2)
panel_3 = Panel(ungroup)
mvolume = VolumeToMesh(Volume=vsmooth, VolumeSettings=vsettings)
panel_4 = Panel(mvolume)
tstat = TreeStatistics(Tree=xy_2)  # -> Paths, Length, Count

# ----
# 列印速度
列印速度_m_sec = Slider(0.15, range=0..1)

item = ListItem(List=tstat.Paths, Index=0, Wrap=True)  # -> Item1, Item
preview = CustomPreview(Geometry=mvolume, Material=ColourSwatch(SwatchColor=RGB(122, 122, 122)))
branch = TreeBranch(Tree=xy_2, Path=item.Item, MaintainPaths=True)
branch_2 = TreeBranch(Tree=xy_2, Path=item.Item1, MaintainPaths=True)
flatten = FlattenTree(Tree=xy_2, Path="{0}")
python = GhPythonScript(plane=flatten)  # -> plane, startPt, endPt; inputs plane: list of Plane
# ---------- python: Python ----------
import rhinoscriptsyntax as rs

plane = plane
a = len(plane) - 1

startPt = plane[0]
endPt = plane[a]
# ---------- end python ----------
X = UnitX(Factor="-200")
Z = UnitZ(Factor="100")
move = Move(Geometry=python.endPt, Motion=X)  # -> Geometry, Transform
預設填料點 = Plane(Plane(origin=(-837.4158325, 606.9471436, -70.23432159), x=(0.7511875281, -0.6597975782, -0.01960748343), y=(0.6597758639, 0.7495853845, 0.05308069962)))
move_2 = Move(Geometry=python.startPt, Motion=Z)  # -> Geometry, Transform
merge = Merge(Data1=move.Geometry, Data2=預設填料點)
lin_move = LINearMovementKUKAPrc(TargetAsPlane=branch_2, ExternalAxis1=cluster_2.s_1, extaxenabled=True, interpolation="C_VEL")
lin_move_2 = LINearMovementKUKAPrc(
    TargetAsPlane=move_2.Geometry,
    Speed=Slider(0.05, range=0..0.1),
    ExternalAxis1=cluster_2.s_1,
    extaxenabled=True,
    interpolation="C_VEL")
lin_move_3 = LINearMovementKUKAPrc(TargetAsPlane=python.startPt, Speed=列印速度_m_sec, ExternalAxis1=cluster_2.s_1, extaxenabled=True, interpolation="C_VEL")
lin_move_4 = LINearMovementKUKAPrc(TargetAsPlane=branch, Speed=列印速度_m_sec, ExternalAxis1=cluster_2.s_1, extaxenabled=True, interpolation="C_VEL")
lin_move_5 = LINearMovementKUKAPrc(TargetAsPlane=python.plane, Speed=列印速度_m_sec, ExternalAxis1=cluster_2.s_1, extaxenabled=True, interpolation="C_VEL")
# OPERATIONS
lin_move_6 = LINearMovementKUKAPrc(TargetAsPlane=merge, Speed=列印速度_m_sec, ExternalAxis1=cluster_2.s_1, extaxenabled=True, interpolation="C_VEL")
停止出料 = Data(io._0)
開始出料 = Data(io._1)
entwine = Entwine(
    Branch00=lin_move_2,
    Branch01=lin_move_3,
    Branch02=lin_move_4,
    Branch03=開始出料,
    Branch04=lin_move_5,
    Branch05=停止出料,
    Branch06=lin_move,
    Branch07=lin_move_6,
    FlattenInputs=True)
data = Data(flatten(entwine))
dam = DataDam(DataA=data, BufferDelay=10000000, BufferMode=0)

# ----
# 3. Simulation, Analysis, Post-Processing
# West Robot
number_slider_3 = Slider(0.5, range=0..1)
save_krl_file = Button()
python_2 = GhPythonScript(plane=selected_plane_2, speed=列印速度_m_sec, save=save_krl_file)  # -> save, name; inputs plane: Int32, height: Int32, layers: Int32, save: Boolean
# ---------- python_2: Python ----------
import rhinoscriptsyntax as rs

SelectedPlane = ['planeO', 'planeA', 'planeB']

SelectedPlane = SelectedPlane[plane]

height = str(height)
layers = str(layers)
speed = str(speed)

n = "W_CP_"+ height+ '_'+ layers+ '_'+ speed+ '_'+ SelectedPlane
n = n.replace('.', 'd')

name = str(n)
# ---------- end python_2 ----------
panel_5 = Panel(python_2.name)
kuka_prc = KUKAPrcCORE(
    SimulationSlider=number_slider_3,
    KUKAPrcCommands=dam,
    Tool=custom_tool_pln,
    Robot=cluster.robot_2,
    CollisionGeometry=collision,
    SaveToggle=python_2.save,
    Filename="M07_pB",
    PRC_BaseExpose=False,
    PRC_SaveNameExpose=True,
    PRCsettings="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")  # -> RobotGeometry, AnalysisOutput

# ----
# 3. Simulation, Analysis, Post-Processing
analysis = AnalysisKUKAPrc(KUKAPrcAnalysisData=kuka_prc.AnalysisOutput)  # -> RobotAxisValues, RobotCollisionCheck, RobotReachabilityCheck, CommandID, TimeValue, flatten(Planes), CommandTags, IOState, Index, KRL
Z_2 = UnitZ(Factor="-10")
# 4. Visualization
move_3 = Move(Geometry=cluster_3.srf_2, Motion=Z_2)  # -> Geometry, Transform

模擬 = ValueList({"開": 0, "關": 1}, selected="關")
rec = DataRecorder(DataLimit=-10, RecordData=True)

pln = Plane(flatten(rec))
vsettings_2 = CreateSettings(VoxelSize=Slider(8, range=0..100), Bandwidth=1, Isovalue=0, Adaptivity=0.1)
nurbs_2 = NurbsCurve(Vertices=pln, Degree=3, Periodic=False)  # -> Curve, Length, Domain
data_2 = Data(world_visual)
data_3 = Data([cluster_2.C, box])
# Robot Workspace
swatch = ColourSwatch(SwatchColor=RGBA(230, 170, 87, 212))
wires = BrepWireframe(Brep=data_2, Density=-1)
data_4 = Data(move_3.Geometry)
data_5 = Data(cluster_2.C)
wires_2 = BrepWireframe(Brep=data_3, Density=-1)
vcurve_2 = CurveToVolume(Curves=nurbs_2.Curve, CurveRadius=Slider(20, range=0..100), Settings=vsettings_2)
preview_2 = CustomPreview(Geometry=data_4, Material=swatch)
preview_3 = CustomPreview(Geometry=data_5, Material=ColourSwatch(SwatchColor=RGB(255, 0, 0)))
preview_4 = CustomPreview(Geometry=wires, Material=ColourSwatch(SwatchColor=RGB(0, 0, 0)))
preview_5 = CustomPreview(Geometry=data_2, Material=ColourSwatch(SwatchColor=RGBA(255, 255, 255, 16)))
preview_6 = CustomPreview(Geometry=vcurve_2, Material=ColourSwatch(SwatchColor=RGB(153, 153, 153)))
preview_7 = CustomPreview(Geometry=wires_2, Material=ColourSwatch(SwatchColor=RGB(255, 255, 255)))

# ==== cluster Cluster
geo = Geometry(flatten([<brep referenced from the Rhino model> x622]))
smooth = SettingsQuality()
holder = Mesh([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])
join = BrepJoin(Breps=holder)  # -> Breps, Closed
mesh = MeshBrep(
    Brep=holder,
    Settings={GridMaxCount=0, GridMinCount=16, JaggedSeams=False, MaxEdgeLength=0, MinEdgeLength=0.0001, MinTolerance=0, Refine=True, RefineAngle=0, RelativeTolerance=0.65, SimplePlanes=True, Tolerance=0})
mjoin = MeshJoin(Meshes=holder)
panel = Panel(mjoin)
kr90_kr270_r2500 = QuantecKR90KR270R2500Robot(infiniterot=False)
panel_2 = Panel("""37.5
2403.3
-2.0
0.0
90.0
-0.1812""")
panel_3 = Panel("""37.0714
2402.8586
-2.0
0.2993
0.0052
0.0001""")
panel_4 = Panel("""0.0
-2400.0
0.0
0.0
90.0
0.0""")
panel_5 = Panel("""-2.06
-2400.320
0
0.01421
-0.0074
0.00""")
west_platform = Mesh(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)
east_platform = Mesh(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)
panel_6 = Panel("""675.0
350.0
1150.0
1000.0
-41.0
240.0""")
rail = Mesh(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)
e1_min = Panel("0")
e1_max = Panel("4270")
item = ListItem(List=panel_4, Index=0, Wrap=True)  # -> Item, Item1, Item2, Item3, Item4, Item5
item_2 = ListItem(List=panel_5, Index=0, Wrap=True)  # -> Item, Item1, Item2, Item3, Item4, Item5
item_3 = ListItem(List=panel_2, Index=0, Wrap=True)  # -> Item, Item1, Item2, Item3, Item4, Item5
item_4 = ListItem(List=panel_3, Index=0, Wrap=True)  # -> Item, Item1, Item2, Item3, Item4, Item5
custom_robot = CustomRobot(ReferenceRobot=kr90_kr270_r2500, RobotName="KR300-R2500", Layout=panel_6)
frame = FrameKUKAPrc(
    FrameNumber=0,
    XValue=item.Item,
    YValue=item.Item1,
    ZValue=item.Item2,
    AValue=item.Item3,
    BValue=item.Item4,
    CValue=item.Item5,
    toolaxis="X")  # -> KUKAPrcFrame, XYZABCAsPlane
frame_2 = FrameKUKAPrc(
    FrameNumber=0,
    XValue=item_2.Item,
    YValue=item_2.Item1,
    ZValue=item_2.Item2,
    AValue=item_2.Item3,
    BValue=item_2.Item4,
    CValue=item_2.Item5,
    toolaxis="Z")  # -> KUKAPrcFrame, XYZABCAsPlane
frame_3 = FrameKUKAPrc(
    FrameNumber=0,
    XValue=item_3.Item,
    YValue=item_3.Item1,
    ZValue=item_3.Item2,
    AValue=item_3.Item3,
    BValue=item_3.Item4,
    CValue=item_3.Item5,
    toolaxis="X")  # -> KUKAPrcFrame, XYZABCAsPlane
frame_4 = FrameKUKAPrc(
    FrameNumber=0,
    XValue=item_4.Item,
    YValue=item_4.Item1,
    ZValue=item_4.Item2,
    AValue=item_4.Item3,
    BValue=item_4.Item4,
    CValue=item_4.Item5,
    toolaxis="Z")  # -> KUKAPrcFrame, XYZABCAsPlane
deplane = DeconstructPlane(Plane=frame.XYZABCAsPlane)  # -> Origin, XAxis, YAxis, ZAxis
deplane_2 = DeconstructPlane(Plane=frame_3.XYZABCAsPlane)  # -> Origin, XAxis, YAxis, ZAxis
move = Move(Motion=Vector(0, 0, 10))  # -> Geometry, Transform
orient = Orient(Geometry=west_platform, Source=PlaneXY(0, 0, 0), Target=frame_2.XYZABCAsPlane)  # -> Geometry, Transform
orient_2 = Orient(Geometry=rail, Source=PlaneXY(0, 0, 0), Target=frame_2.XYZABCAsPlane)  # -> Geometry, Transform
orient_3 = Orient(Geometry=rail, Source=PlaneXY(0, 0, 0), Target=frame_4.XYZABCAsPlane)  # -> Geometry, Transform
orient_4 = Orient(Geometry=east_platform, Source=PlaneXY(0, 0, 0), Target=frame_4.XYZABCAsPlane)  # -> Geometry, Transform
orient_5 = Orient(Geometry=holder, Source=PlaneXY(0, 0, 0), Target=frame_4.XYZABCAsPlane)  # -> Geometry, Transform
panel_7 = Panel(orient_4.Geometry)
custom_rail = CustomLinearAxisKUKAPrc(
    KUKAPrcRobotInput=custom_robot,
    RobotRail=orient_3.Geometry,
    RobotPlatform=orient_4.Geometry,
    PositiveLength=e1_max,
    NegativeLength=e1_min,
    PositiveDirection=deplane_2.XAxis,
    RobotBase=frame_4.XYZABCAsPlane)
custom_rail_2 = CustomLinearAxisKUKAPrc(
    KUKAPrcRobotInput=custom_robot,
    RobotRail=orient_2.Geometry,
    RobotPlatform=orient.Geometry,
    PositiveLength=e1_max,
    NegativeLength=e1_min,
    PositiveDirection=deplane.XAxis,
    RobotBase=frame_2.XYZABCAsPlane)
robot = ClusterOutput(custom_rail_2)
robot_2 = ClusterOutput(custom_rail)

# ==== cluster IO
toggle = BooleanToggle(False)
toggle_2 = BooleanToggle(True)
digital_out = DigitalOutputKUKAPrc(DigitalOutputNumber="1", OutputState=toggle_2, ContinuousMovement=toggle_2, ToolState=-1)
digital_out_2 = DigitalOutputKUKAPrc(DigitalOutputNumber="1", OutputState=toggle, ContinuousMovement=toggle_2, ToolState=-1)
digital_out_3 = DigitalOutputKUKAPrc(DigitalOutputNumber="2", OutputState=toggle_2, ContinuousMovement=toggle_2, ToolState=-1)
digital_out_4 = DigitalOutputKUKAPrc(DigitalOutputNumber="3", OutputState=toggle_2, ContinuousMovement=toggle_2, ToolState=-1)
digital_out_5 = DigitalOutputKUKAPrc(DigitalOutputNumber="2", OutputState=toggle, ContinuousMovement=toggle_2, ToolState=-1)
digital_out_6 = DigitalOutputKUKAPrc(DigitalOutputNumber="3", OutputState=toggle, ContinuousMovement=toggle_2, ToolState=-1)
merge = Merge(Data1=digital_out_2, Data2=digital_out_5, Data3=digital_out_6)
merge_2 = Merge(Data1=digital_out, Data2=digital_out_5, Data3=digital_out_6)
merge_3 = Merge(Data1=digital_out_2, Data2=digital_out_3, Data3=digital_out_6)
merge_4 = Merge(Data1=digital_out_2, Data2=digital_out_5, Data3=digital_out_4)
entwine = Entwine(Branch0X=merge, Branch1X=merge_2, Branch2X=merge_3, Branch3X=merge_4, FlattenInputs=False)  # -> simplify(Result)
bang = ExplodeTree(Data=entwine)  # -> flatten(Branch0), flatten(Branch1), flatten(Branch2), flatten(Branch3)
_0 = ClusterOutput(bang.Branch0)
_1 = ClusterOutput(bang.Branch1)
_2 = ClusterOutput(bang.Branch2)
_3 = ClusterOutput(bang.Branch3)

# ==== cluster Cluster_2
data = ClusterInput()
O = ClusterInput()
X = ClusterInput()
plane = Plane(Plane(origin=(107, 819, -453), x=(0.999936913, -0.01083675472, 0.00295547856), y=(0.01083708922, 0.9999412723, -9.718915386e-05)))
plane_a = Plane(Plane(origin=(-487, 831, -435), x=(0.9997123019, -0.02392473885, -0.001708909918), y=(0.02390597081, 0.999661481, -0.01026781271)))
plane_b = Plane(Plane(origin=(739, 802, -435), x=(0.999928172, -0.01198544042, 0), y=(0.01198501305, 0.9998925174, -0.008444712633)))
data_2 = Data(data)
panel = Panel("""2400
1200""")
panel_2 = Panel("""1200
1200""")
filter = StreamFilter(Gate=data_2, Stream0=plane, Stream1=plane_a, Stream2=plane_b)
filter_2 = StreamFilter(Gate=data_2, Stream0=panel, Stream1=panel_2, Stream2=panel_2)
item = ListItem(List=filter_2, Index=0, Wrap=True)  # -> Item, Item1
pl_offset = PlaneOffset(BasePlane=filter, Offset=O)
planesrf = PlaneSurface(Plane=pl_offset, XSize=item.Item, YSize=item.Item1)
area = Area(Geometry=planesrf)  # -> Area, Centroid
neg = Negative(Value=Slider(100, range=0..100))
orient = Orient(Geometry=planesrf, Source=area.Centroid, Target=pl_offset)  # -> Geometry, Transform
vec = VectorXYZ(XComponent=X, YComponent=X, ZComponent=0)  # -> Vector, Length
filter_3 = StreamFilter(Gate=data_2, Stream1="900", Stream2="300")
move = Move(Geometry=pl_offset, Motion=vec.Vector)  # -> Geometry, Transform
offset_l = OffsetCurveLoose(Curve=orient.Geometry, Distance=neg)
srf = Surface(orient.Geometry)
panel_3 = Panel(move.Geometry)
G = ClusterOutput(move.Geometry)
srf_2 = ClusterOutput(srf)
C = ClusterOutput(offset_l)
s_1 = ClusterOutput(filter_3)

# ==== cluster Cluster_3
data = ClusterInput()
O = ClusterInput()
X = ClusterInput()
plane = Plane(Plane(origin=(107, 819, -453), x=(0.999936913, -0.01083675472, 0.00295547856), y=(0.01083708922, 0.9999412723, -9.718915386e-05)))
plane_a = Plane(Plane(origin=(-487, 831, -435), x=(0.9997123019, -0.02392473885, -0.001708909918), y=(0.02390597081, 0.999661481, -0.01026781271)))
plane_b = Plane(Plane(origin=(739, 802, -435), x=(0.999928172, -0.01198544042, 0), y=(0.01198501305, 0.9998925174, -0.008444712633)))
data_2 = Data(data)
panel = Panel("""2400
1200""")
panel_2 = Panel("""1200
1200""")
filter = StreamFilter(Gate=data_2, Stream0=plane, Stream1=plane_a, Stream2=plane_b)
filter_2 = StreamFilter(Gate=data_2, Stream0=panel, Stream1=panel_2, Stream2=panel_2)
item = ListItem(List=filter_2, Index=0, Wrap=True)  # -> Item, Item1
pl_offset = PlaneOffset(BasePlane=filter, Offset=O)
planesrf = PlaneSurface(Plane=pl_offset, XSize=item.Item, YSize=item.Item1)
area = Area(Geometry=planesrf)  # -> Area, Centroid
neg = Negative(Value=Slider(100, range=0..100))
orient = Orient(Geometry=planesrf, Source=area.Centroid, Target=pl_offset)  # -> Geometry, Transform
vec = VectorXYZ(XComponent=X, YComponent=X, ZComponent=0)  # -> Vector, Length
filter_3 = StreamFilter(Gate=data_2, Stream1="900", Stream2="300")
move = Move(Geometry=pl_offset, Motion=vec.Vector)  # -> Geometry, Transform
offset_l = OffsetCurveLoose(Curve=orient.Geometry, Distance=neg)
srf = Surface(orient.Geometry)
panel_3 = Panel(move.Geometry)
G = ClusterOutput(move.Geometry)
srf_2 = ClusterOutput(srf)
C = ClusterOutput(offset_l)
s_0 = ClusterOutput(filter_3)
